% Simulink data dictionary myDDFinal.sldd

C = Simulink.Parameter(0.2, StorageClass="ExportedGlobal", Alias="C")
B = Simulink.Parameter(0.25, StorageClass="ExportedGlobal", Alias="B")
A = Simulink.Parameter(0.95, StorageClass="ExportedGlobal", Alias="A")
D = Simulink.Parameter(0, StorageClass="ExportedGlobal", Alias="D")