test file "DiskBrakeThermal_TestSuite"
  description: DiskBrakeThermal validation test suite (mirrors test_scenarios_matlab.m)

suite "Thermal Scenarios"
  description: Multi-stop thermal scenarios: fade and city driving

  case "Fade Test 15 Stops" [simulation]
    description: Fade test: 15 repeated stops from 100 km/h at ~0.4g
    model DiskBrakeThermal, stop time 500
    parameter set "Initial Speed": v0 = 27.8
    input "input_fade_test.mat" (active)
    pre-load callback:
      run(fullfile('L:/Projects/ThermalBrake', 'disk_brake_thermal_params.m'));
    custom criteria:
      T_rotor = test.sltest_simout.yout{1}.Values.Data;
      T_rotor_final = T_rotor(end);
      test.verifyGreaterThan(T_rotor_final, 100, ...
          sprintf('T_rotor final %.0f degC too low', T_rotor_final));
      test.verifyLessThan(T_rotor_final, 700, ...
          sprintf('T_rotor final %.0f degC too high', T_rotor_final));

  case "City Driving 10 Stops" [simulation]
    description: City driving: 10 stops from 50 km/h at ~0.3g
    model DiskBrakeThermal, stop time 350
    parameter set "Initial Speed": v0 = 13.9
    input "input_city_driving.mat" (active)
    pre-load callback:
      run(fullfile('L:/Projects/ThermalBrake', 'disk_brake_thermal_params.m'));
    custom criteria:
      T_rotor = test.sltest_simout.yout{1}.Values.Data;
      T_rotor_peak = max(T_rotor);
      T_rotor_final = T_rotor(end);
      test.verifyLessThan(T_rotor_peak, 200, ...
          sprintf('T_rotor peak %.0f degC exceeds 200 degC limit', T_rotor_peak));
      test.verifyLessThan(T_rotor_final, 150, ...
          sprintf('T_rotor final %.0f degC not cooling toward ambient', T_rotor_final));

suite "Energy Conservation"
  description: Verify thermal energy stored is physically consistent

  case "Energy Conservation Emergency Stop" [simulation]
    description: Emergency stop: stored energy is positive and < vehicle KE
    model DiskBrakeThermal, stop time 10
    parameter set "Initial Speed": v0 = 27.8
    input "input_emergency_stop.mat" (active)
    pre-load callback:
      run(fullfile('L:/Projects/ThermalBrake', 'disk_brake_thermal_params.m'));
    custom criteria:
      T_rotor = test.sltest_simout.yout{1}.Values.Data;
      T_pad   = test.sltest_simout.yout{2}.Values.Data;
      % Parameters (from disk_brake_thermal_params.m)
      m_r = 6.0; c_r = 449; m_p = 0.30; c_p = 935; m_veh = 1700;
      E_stored_rotor = m_r * c_r * (T_rotor(end) - 25);
      E_stored_pad   = m_p * c_p * (T_pad(end) - 25);
      E_stored = E_stored_rotor + E_stored_pad;
      KE_total = 0.5 * m_veh * 27.8^2;
      test.verifyGreaterThan(E_stored, 0, 'Stored energy should be positive');
      test.verifyLessThan(E_stored, KE_total, ...
          'Stored energy should be less than total vehicle KE');

suite "Numerical Robustness"
  description: Verify results are insensitive to solver settings

  case "RelTol Sensitivity" [simulation]
    description: Emergency stop with RelTol = 1e-4, 1e-6, 1e-8
    model DiskBrakeThermal, stop time 10
    parameter set "Initial Speed": v0 = 27.8
    input "input_emergency_stop.mat" (active)
    pre-load callback:
      run(fullfile('L:/Projects/ThermalBrake', 'disk_brake_thermal_params.m'));
    custom criteria:
      T_rotor_final = test.sltest_simout.yout{1}.Values.Data(end);
      % Each iteration must produce a physically reasonable result
      test.verifyGreaterThan(T_rotor_final, 25, 'T_rotor should exceed ambient');
      test.verifyLessThan(T_rotor_final, 200, 'T_rotor should be below 200 degC');
    iteration script:
      relTols = {'1e-6', '1e-4', '1e-8'};
      names   = {'RelTol_1e-6_baseline', 'RelTol_1e-4_loose', 'RelTol_1e-8_tight'};
      for k = 1:3
          itr = sltestiteration;
          itr.Name = names{k};
          setTestParam(itr, 'PreLoadFcn', ...
              sprintf('set_param(''DiskBrakeThermal'', ''RelTol'', ''%s'');', relTols{k}));
          addIteration(sltest_testCase, itr);
      end

  case "Solver Sensitivity" [simulation]
    description: Emergency stop with ode45 vs ode23t
    model DiskBrakeThermal, stop time 10
    parameter set "Initial Speed": v0 = 27.8
    input "input_emergency_stop.mat" (active)
    pre-load callback:
      run(fullfile('L:/Projects/ThermalBrake', 'disk_brake_thermal_params.m'));
    custom criteria:
      T_rotor_final = test.sltest_simout.yout{1}.Values.Data(end);
      test.verifyGreaterThan(T_rotor_final, 25, 'T_rotor should exceed ambient');
      test.verifyLessThan(T_rotor_final, 200, 'T_rotor should be below 200 degC');
    iteration script:
      solvers = {'ode45', 'ode23t'};
      names   = {'ode45_baseline', 'ode23t_alternative'};
      for k = 1:2
          itr = sltestiteration;
          itr.Name = names{k};
          setTestParam(itr, 'PreLoadFcn', ...
              sprintf('set_param(''DiskBrakeThermal'', ''Solver'', ''%s'');', solvers{k}));
          addIteration(sltest_testCase, itr);
      end

suite "Parameter Sensitivity"
  description: Verify model responds correctly to parameter variations

  case "Rotor Mass Sensitivity" [simulation]
    description: Emergency stop with m_r = 4.5, 6.0, 8.0 kg
    model DiskBrakeThermal, stop time 10
    parameter set "Initial Speed": v0 = 27.8
    input "input_emergency_stop.mat" (active)
    pre-load callback:
      run(fullfile('L:/Projects/ThermalBrake', 'disk_brake_thermal_params.m'));
    custom criteria:
      T_rotor = test.sltest_simout.yout{1}.Values.Data;
      T_rotor_peak = max(T_rotor);
      test.verifyGreaterThan(T_rotor_peak, 60, ...
          sprintf('T_peak %.1f degC too low', T_rotor_peak));
      test.verifyLessThan(T_rotor_peak, 200, ...
          sprintf('T_peak %.1f degC too high', T_rotor_peak));
    iteration script:
      masses = [4.5, 6.0, 8.0];
      names  = {'m_r_4p5kg', 'm_r_6p0kg', 'm_r_8p0kg'};
      for k = 1:3
          itr = sltestiteration;
          itr.Name = names{k};
          setTestParam(itr, 'PreLoadFcn', ...
              sprintf('assignin(''base'', ''m_r'', %.1f);', masses(k)));
          addIteration(sltest_testCase, itr);
      end