% Simulink data dictionary GalacticSoupFunctionalInterfaces.sldd

RecipeSpec = Simulink.Bus()
  RecipeId: uint32
  CookTemperature: double
  CookDuration: double

IngredientRequest = Simulink.Bus()
  BatchId: uint32
  TotalMass: double

IngredientDelivery = Simulink.Bus()
  BatchId: uint32
  TotalMass: double

CookedBatch = Simulink.Bus()
  BatchId: uint32
  RecipeId: uint32
  Volume: double
  Temperature: double

QCOutcome = Simulink.Bus()
  BatchId: uint32
  Accepted: boolean
  Reason: uint32

PackagedBatch = Simulink.Bus()
  BatchId: uint32
  ContainerCount: uint32
  DestinationId: uint32

Manifest = Simulink.Bus()
  BatchId: uint32
  DestinationId: uint32
  ContainerCount: uint32
  DispatchTime: double

ProductionCommand = Simulink.Bus()
  Command: uint32
  TargetRate: double

ProductionStatus = Simulink.Bus()
  SubsystemId: uint32
  State: uint32
  Rate: double
  FaultFlags: uint32

RocketSchedule = Simulink.Bus()
  RocketId: uint32
  SlotIndex: uint32
  ArrivalTime: double
  LoadingWindow: double