% Simulink data dictionary GalacticSoupLogicalInterfaces.sldd

RecipeProgram = Simulink.Bus()
  RecipeId: uint32
  StepCount: uint32
  NominalDuration: double
  NominalTemperature: double

IngredientBatch = Simulink.Bus()
  BatchId: uint32
  TotalMass: double
  ColdChain: boolean
  Prepared: boolean

CookedBatch = Simulink.Bus()
  BatchId: uint32
  RecipeId: uint32
  Volume: double
  CenterTemperature: double

QCVerdict = Simulink.Bus()
  BatchId: uint32
  Accepted: boolean
  FaultCode: uint32

PackagedBatch = Simulink.Bus()
  BatchId: uint32
  ContainerCount: uint32
  DestinationId: uint32
  SealIntegrity: boolean

ManifestRecord = Simulink.Bus()
  BatchId: uint32
  DestinationId: uint32
  ContainerCount: uint32
  DispatchTimestamp: double

RocketPadSignal = Simulink.Bus()
  PadIndex: uint32
  RocketPresent: boolean
  Countdown: double

ControlSignal = Simulink.Bus()
  Command: uint32
  TargetRate: double
  State: uint32
  FaultFlags: uint32