% Simulink data dictionary GalacticSoupPhysicalInterfaces.sldd

ColdIngredientFlow = Simulink.Bus()
  BatchId: uint32
  Mass_kg: double
  Temperature_C: double
  ContainerType: uint32
  Prepared: boolean

AmbientIngredientFlow = Simulink.Bus()
  BatchId: uint32
  Mass_kg: double
  ContainerType: uint32
  Prepared: boolean

CookedSoupFlow = Simulink.Bus()
  BatchId: uint32
  Volume_L: double
  Temperature_C: double

PackagedSoupFlow = Simulink.Bus()
  BatchId: uint32
  ContainerCount: uint32
  SealPressure_kPa: double

ControlBus = Simulink.Bus()
  Command: uint32
  TargetRate_bph: double
  State: uint32
  FaultFlags: uint32

RocketPadStatus = Simulink.Bus()
  PadIndex: uint32
  RocketPresent: boolean
  Countdown_s: double
  FuelLevel_pct: double

ManifestData = Simulink.Bus()
  BatchId: uint32
  DestinationId: uint32
  ContainerCount: uint32
  DispatchTime_s: double

RecipeData = Simulink.Bus()
  RecipeId: uint32
  StepCount: uint32
  NominalDuration_s: double
  NominalTemperature_C: double