# Requirement set SystemRequirements (R2025b)

Attributes:
- DerivedFrom: Imported from Excel:DerivedFrom

## 1 [SR-GS-001] Recipe count
System shall cook at least 8 distinct recipes selectable at runtime.
Rationale: Eight recipes gives menu variety while staying within ingredient storage and recipe-validation budgets.
DerivedFrom: SN-GS-001

## 2 [SR-GS-002] Throughput
System shall sustain total throughput of at least 200 bowls/hour.
Rationale: 200 bowls/hour matches expected peak order rate aggregated across customer worlds.
DerivedFrom: SN-GS-001

## 3 [SR-GS-003] Automation level
System shall achieve average automation level of at least 0.8 across components.
Rationale: 0.8 automation lets the 5-operator crew cover a 24/7 facility with rotation and breaks.
DerivedFrom: SN-GS-002

## 4 [SR-GS-004] Operator count
System shall require at most 5 concurrent operators at peak load.
Rationale: Facility berthing and life support are sized for a 5-person crew.
DerivedFrom: SN-GS-002

## 5 [SR-GS-005] Shipping manifest
System shall generate a shipping manifest per batch including destination.
Rationale: Manifest is required for customs, transport routing, and recipient confirmation on delivery.
DerivedFrom: SN-GS-003

## 6 [SR-GS-006] Transport loading time
System shall load packaged soup onto transport within 10 minutes of packaging.
Rationale: 10-minute window keeps loading pipeline aligned with the 200 bowls/hour production rate.
DerivedFrom: SN-GS-003

## 7 [SR-GS-007] Contamination detection
System shall detect contamination before sealing with at least 99% sensitivity.
Rationale: 99% sensitivity balances false-positive rework cost against the downstream cost of a contaminated shipment.
DerivedFrom: SN-GS-004

## 8 [SR-GS-008] Serving temperature
System shall verify soup temperature in 70-95 C before QC sign-off.
Rationale: 70-95 C is the safe serving range: above pathogen-kill threshold and below scald risk.
DerivedFrom: SN-GS-004

## 9 [SR-GS-009] Container seal life
System shall seal containers rated for 30-day interstellar transit.
Rationale: 30 days covers typical transit time to the farthest customer worlds with margin.
DerivedFrom: SN-GS-005

## 10 [SR-GS-010] Inventory accuracy
System shall track ingredient inventory with at most 1% stock error.
Rationale: 1% stock error keeps reorder decisions accurate enough to avoid production-halting stock-outs.
DerivedFrom: SN-GS-006

## 11 [SR-GS-011] Mass budget
Total system mass shall not exceed 15000 kg.
Rationale: Allocated from the facility deployment mass budget.
DerivedFrom: SN-GS-007

## 12 [SR-GS-012] Power budget
Total system power draw shall not exceed 500 kW.
Rationale: Allocated from the facility power budget.
DerivedFrom: SN-GS-007

## 13 [SR-GS-013] Cost budget
Total system cost shall not exceed 2000000 credits.
Rationale: Allocated from the facility capital cost budget.
DerivedFrom: SN-GS-007

## 14 [SR-GS-014] Volume budget
Total system volume shall not exceed 400 m^3.
Rationale: Allocated from the facility floor-space and volume budget.
DerivedFrom: SN-GS-007

## 15 [SR-GS-015] Gravity operating range
System shall perform all cooking, packaging, and shipping functions nominally across ambient gravity 0.1 g to 12 g.
Rationale: 0.1-12 g spans the full ambient gravity range across candidate customer worlds.
DerivedFrom: SN-GS-008

## 16 [SR-GS-016] Structural 12 g tolerance
System structure and mounts shall withstand sustained 12 g loading without permanent deformation.
Rationale: 12 g is the worst-case sustained ambient gravity among customer worlds.
DerivedFrom: SN-GS-008

## 17 [SR-GS-017] Concurrent rocket support
System shall support simultaneous handling of at least 3 delivery rockets for loading or unloading.
Rationale: Parallel handling prevents outbound shipping from blocking inbound ingredient deliveries.
DerivedFrom: SN-GS-009

## 18 [SR-GS-018] Rocket turnaround
System shall complete loading or unloading of a delivery rocket within 20 minutes.
Rationale: Fast turnaround maximizes fleet utilization and maintains alignment with production throughput.
DerivedFrom: SN-GS-009

## 19 [SR-GS-019] Rocket refueling
System shall provide on-site refueling capability for supported delivery rockets.
Rationale: On-site refueling minimizes logistics dependencies and enables rapid redeployment.
DerivedFrom: SN-GS-009

## 20 [SR-GS-020] Temperature-controlled storage
System shall provide separate storage zones for cold and room-temperature ingredients.
Rationale: Different ingredient classes require different storage conditions to maintain safety and quality.
DerivedFrom: SN-GS-010

## 21 [SR-GS-021] Ingredient storage capacity
System shall store at least 72 hours of ingredients at nominal production rate.
Rationale: 72 hours of buffer mitigates delivery delays without exceeding storage mass and volume budgets.
DerivedFrom: SN-GS-010

## 22 [SR-GS-022] Cooking capacity
System shall cook soup at a sustained rate sufficient to meet overall throughput requirements.
Rationale: Cooking must not be the bottleneck in achieving 200 bowls/hour system throughput.
DerivedFrom: SN-GS-011

## 23 [SR-GS-023] Internal transfer time
System shall transport ingredients from storage to cooking at a rate sufficient to sustain nominal cooking throughput.
Rationale: Cooking throughput must not be limited by internal ingredient transport.
DerivedFrom: SN-GS-012

## 24 [SR-GS-024] Internal transport automation
Internal material transport shall be automated for at least 90% of transfers.
Rationale: High automation supports low crew size and reduces operator workload.
DerivedFrom: SN-GS-012

## 25 [SR-GS-025] Startup readiness
System shall reach nominal operating throughput within a defined startup period after activation.
Rationale: Ensures the system can transition from inactive to productive operation without extended downtime.
DerivedFrom: SN-GS-013

## 26 [SR-GS-026] Fault-induced throughput degredation
System shall prevent uncontrolled termination of production due to single internal component faults.
Rationale: Should tolerate individual component failures without complete loss of production.
DerivedFrom: SN-GS-014

## 27 [SR-GS-027] Production coordination
System shall coordinate internal operations to satisfy throughput, safety, and logistical constraints concurrently.
Rationale: Ensures that throughput, safety, and logistics objectives are met simultaneously in a highly automated system.
DerivedFrom: SN-GS-015

## 28 [SR-GS-028] Preparation zone
System shall include a separate ingredient preparation zone supporting chopping and weighing of ingredients, physically isolated from storage and cooking zones. The zone shall sustain prep throughput of at least 200 bowls/hour equivalent.
Rationale: A dedicated prep zone keeps raw/prepped materials separated and sized so it does not bottleneck the cooking line.
DerivedFrom: SN-GS-001