% Simulink data dictionary craneDD.sldd

ctrl_K = [-10 -21.52355 -312.5777 -112.3005]
ctrl_centerDamping = 10
ctrl_centerGain = 18
ctrl_clearanceMargin = 0.05
ctrl_forceMax = 60
ctrl_lqrScale = 0.12
ctrl_pendulumLength = 1.4
ctrl_postClearDamping = 12
ctrl_postClearGain = 8
ctrl_pumpControlAmplitude = 37.2
ctrl_pumpControlDuration = 7.6
ctrl_pumpControlPhase = 0.6283185
ctrl_pumpFrequency = 2.541217
ctrl_targetX = 3
ctrl_transferClearance = 0.65
ctrl_transferDamping = 8
ctrl_transferForce = 60
ctrl_wallTop = -1
ctrl_wallX = 1.45